# Grasshopper definition Folded.gh (Grasshopper 1.0.8)
# plug-ins: rhino-gh-mcp

number_slider = Slider(10, range=0..10)

# ----
# 1st Rectangle
# Isolate Rotation Axis
number_slider_2 = Slider(2, range=0..10)
# 2nd Rectangle
rotation = Slider(15, range=0..100)
rectangle = Rectangle(Plane=PlaneXY(0, 0, 0), XSize=number_slider_2, YSize=number_slider, Radius=0)  # -> Rectangle, Length
negative = Negative(Value=rotation)
radians = Radians(Degrees=negative)
axis_of_rotation = Slider(1, range=0..100)
explode = Explode(Curve=rectangle.Rectangle, Recursive=True)  # -> Segments, Vertices
list_item = ListItem(List=explode.Segments, Index=axis_of_rotation, Wrap=True)
rotate_axis = RotateAxis(Geometry=rectangle.Rectangle, Angle=radians, Axis=list_item)  # -> Geometry, Transform

point_for_plane = Slider(1, range=0..100)
list_item_2 = ListItem(List=explode.Vertices, Index=point_for_plane, Wrap=True)
yz_plane = YZPlane(Origin=list_item_2)
mirror = Mirror(Geometry=rotate_axis.Geometry, Plane=yz_plane)  # -> Geometry, Transform

scenario = ValueList({"Inspect (0)": 0, "Tune (1)": 1, "Coach (2)": 2, "Execute (3)": 3, "Author (4)": 4}, selected="Author (4)")
number_slider_3 = Slider(1, range=0..1)
run = BooleanToggle(False)
mcpv2 = RhinoGhMcpServerV2(
    RunServer=run,
    Scenario=scenario,
    Port=9999,
    OverrideAllowParameters=number_slider_3,
    OverrideAllowComponents=number_slider_3,
    OverrideAllowScripting=-1,
    OverrideComponentScope=Slider(2, range=0..10),
    AutoRecompute=False)  # -> Status, DebugOutput, Version

# ----
# Solving for X Distance
explode_2 = Explode(Curve=rotate_axis.Geometry, Recursive=True)  # -> Segments, Vertices
explode_3 = Explode(Curve=mirror.Geometry, Recursive=True)  # -> Segments, Vertices
point_1 = Slider(0, range=0..10)
point_1_2 = Slider(0, range=0..10)
list_item_3 = ListItem(List=explode_2.Vertices, Index=point_1, Wrap=True)
list_item_4 = ListItem(List=explode_3.Vertices, Index=point_1_2, Wrap=True)
distance = Distance(PointA=list_item_3, PointB=list_item_4)

# ----
# Y Direction Array
y_count = Slider(4, range=0..100)
series = Series(Start=0, Step=number_slider, Count=y_count)
unit_y = UnitY(Factor=series)
cross_reference = CrossReference(ListListA=rotate_axis.Geometry, ListListB=mirror.Geometry, CrossMode=1)  # -> ListListA, ListListB
move = Move(Geometry=graft([cross_reference.ListListA, cross_reference.ListListB]), Motion=unit_y)  # -> Geometry, Transform

# ----
# X Direction Array
x_count = Slider(10, range=0..10)
series_2 = Series(Start=0, Step=distance, Count=x_count)
unit_x = UnitX(Factor=series_2)
move_2 = Move(Geometry=graft(move.Geometry), Motion=unit_x)  # -> Geometry, Transform

# ----
# Adding Thickness
number_slider_4 = Slider(0.2, range=0..1)
surface = Surface(move_2.Geometry)
unit_z = UnitZ(Factor=number_slider_4)
extrude = Extrude(Base=surface, Direction=unit_z)
