# Grasshopper definition Origami Faceted.gh (Grasshopper 1.0.8)
# plug-ins: rhino-gh-mcp, LunchBox

rectangle = Rectangle(Plane=PlaneXY(0, 0, 0), XSize=Slider(10, range=0..10), YSize=Slider(10, range=0..10), Radius=0)  # -> Rectangle, Length
surface = Surface(rectangle.Rectangle)

scenario = ValueList({"Inspect (0)": 0, "Tune (1)": 1, "Coach (2)": 2, "Execute (3)": 3, "Author (4)": 4}, selected="Author (4)")
number_slider = Slider(1, range=0..1)
run = BooleanToggle(True)
mcpv2 = RhinoGhMcpServerV2(
    RunServer=run,
    Scenario=scenario,
    Port=9999,
    OverrideAllowParameters=number_slider,
    OverrideAllowComponents=number_slider,
    OverrideAllowScripting=-1,
    OverrideComponentScope=Slider(2, range=0..10),
    AutoRecompute=False)  # -> Status, DebugOutput, Version
# Origami/Facated Facade
number_slider_2 = Slider(14, range=0..100)
quad_panels = QuadPanels(Surface=surface, UDivisions=number_slider_2, VDivisions=number_slider_2)
deconstruct_brep = DeconstructBrep(Brep=quad_panels)  # -> Faces, Edges, Vertices
point_on_curve = PointOnCurve(deconstruct_brep.Edges, parameter=0.5)
polyline = PolyLine(Vertices=point_on_curve, Closed=invert(False))
area = Area(Geometry=polyline)  # -> Area, Centroid

# ----
# Attractor Points
amount_of_attractor_points = Slider(5, range=0..10)
populate_geometry = PopulateGeometry(Geometry=surface, Count=amount_of_attractor_points, Seed=1)
pull_point = PullPoint(Point=area.Centroid, Geometry=populate_geometry, ClosestOnly=True)  # -> ClosestPoint, flatten(Distance), Index

end_points = EndPoints(Curve=deconstruct_brep.Edges)  # -> Start, End
sort_list = SortList(Keys=pull_point.Distance)  # -> Keys, ValuesValuesA
reverse_list = ReverseList(List=sort_list.Keys)
list_item = ListItem(List=reverse_list, Index=0, Wrap=True)
division = Division(A=list_item, B=Slider(2, range=0..10))
minimum = Minimum(A=pull_point.Distance, B=division)
construct_domain = ConstructDomain(DomainStart=Slider(0.1, range=0..0.1), DomainEnd=Slider(0.9, range=0..1))
bounds = Bounds(Numbers=minimum)
remap_numbers = RemapNumbers(Value=minimum, Source=bounds, Target=construct_domain)  # -> Mapped, Clipped
scale = Scale(Geometry=flatten(polyline), Center=flatten(area.Centroid), Factor=remap_numbers.Mapped)  # -> Geometry, Transform
discontinuity = Discontinuity(Curve=scale.Geometry, Level=1)  # -> Points, Parameters
offset_surface = OffsetSurface(Surface=scale.Geometry, Distance=Slider(0.2, range=0..1), Retrim=True)
area_2 = Area(Geometry=offset_surface)  # -> Area, Centroid
area_3 = Area(Geometry=scale.Geometry)  # -> Area, Centroid

line = Line(StartPoint=end_points.Start, EndPoint=discontinuity.Points)
line_2 = Line(StartPoint=end_points.End, EndPoint=discontinuity.Points)
join_curves = JoinCurves(Curves=[line, line_2], Preserve=False)
boundary_surfaces = BoundarySurfaces(Edges=join_curves)

height_of_peaks = Slider(0.5, range=0..10)
vector_2pt = Vector2Pt(PointA=area_2.Centroid, PointB=area_3.Centroid, Unitize=False)  # -> Vector, Length
multiplication = Multiplication(A=remap_numbers.Mapped, B=height_of_peaks)
amplitude = Amplitude(Vector=vector_2pt.Vector, Amplitude=multiplication)
move = Move(Geometry=area_3.Centroid, Motion=amplitude)  # -> Geometry, Transform
extrude_point = ExtrudePoint(Base=boundary_surfaces, Point=graft(move.Geometry))
