# Grasshopper definition Kinetic.gh (Grasshopper 1.0.8)
# plug-ins: rhino-gh-mcp, LunchBox

# ----
# Base Surface
number_slider = Slider(4, range=0..10)
# Must be a XZ or YZ Plane
# (Vertical)
xz_plane = XZPlane(Origin=Point(0, 0, 0))
rectangle = Rectangle(Plane=xz_plane, XSize=Slider(10, range=0..100), YSize=number_slider, Radius=0)  # -> Rectangle, Length
surface = Surface(rectangle.Rectangle)

triangle_panels_b = TrianglePanelsB(Surface=surface, UDivisions=10, VDivisions=10)
# Must be #<Area
number_slider_2 = Slider(0.24, range=0..10)
area = Area(Geometry=triangle_panels_b)  # -> Area, Centroid
panel = Panel(area.Area)
smaller_than = SmallerThan(FirstNumber=flatten(area.Area), SecondNumber=number_slider_2)  # -> SmallerThan, OrEqualTo
dispatch = Dispatch(List=simplify(triangle_panels_b), DispatchPattern=simplify(smaller_than.SmallerThan))  # -> ListA, ListB
surface_2 = Surface(dispatch.ListB)
list_item = ListItem(List=graft(surface_2), Index=0, Wrap=True)
deconstruct_brep = DeconstructBrep(Brep=list_item)  # -> Faces, Edges, Vertices
area_2 = Area(Geometry=deconstruct_brep.Faces)  # -> Area, Centroid
number_slider_3 = Slider(1, range=0..1)
scenario = ValueList({"Inspect (0)": 0, "Tune (1)": 1, "Coach (2)": 2, "Execute (3)": 3, "Author (4)": 4}, selected="Author (4)")
protrusion_amount = Slider(0.47, range=0..21)
run = BooleanToggle(True)
evaluate_surface = EvaluateSurface(Surface=deconstruct_brep.Faces, Point=area_2.Centroid)  # -> Point, Normal, UDirection, VDirection, Frame
mcpv2 = RhinoGhMcpServerV2(
    RunServer=run,
    Scenario=scenario,
    Port=9999,
    OverrideAllowParameters=number_slider_3,
    OverrideAllowComponents=number_slider_3,
    OverrideAllowScripting=number_slider_3,
    OverrideComponentScope=Slider(2, range=0..10),
    AutoRecompute=False)  # -> Status, DebugOutput, Version
multiplication = Multiplication(A=evaluate_surface.Normal, B=protrusion_amount)
move = Move(Geometry=area_2.Centroid, Motion=multiplication)  # -> Geometry, Transform
extrude_point = ExtrudePoint(Base=deconstruct_brep.Faces, Point=move.Geometry)
thickness = Slider(0.06, range=0..0.1)
# Key Sliders
opening_angle = Slider(12, range=0..100)
deconstruct_brep_2 = DeconstructBrep(Brep=extrude_point)  # -> Faces, Edges, Vertices
list_item_2 = ListItem(List=deconstruct_brep_2.Faces, Index=0, Wrap=True)  # -> Item, Item1, Item2, Item3
# Faces of
# Base Triangle
deconstruct_brep_3 = DeconstructBrep(Brep=list_item_2.Item1)  # -> Faces, Edges, Vertices
deconstruct_brep_4 = DeconstructBrep(Brep=list_item_2.Item2)  # -> Faces, Edges, Vertices
deconstruct_brep_5 = DeconstructBrep(Brep=list_item_2.Item3)  # -> Faces, Edges, Vertices
list_item_3 = ListItem(List=deconstruct_brep_3.Edges, Index=0, Wrap=True)
list_item_4 = ListItem(List=deconstruct_brep_4.Edges, Index=0, Wrap=True)
list_item_5 = ListItem(List=deconstruct_brep_5.Edges, Index=0, Wrap=True)
rotate_axis = RotateAxis(Geometry=deconstruct_brep_3.Faces, Angle=degrees(opening_angle), Axis=list_item_3)  # -> Geometry, Transform
rotate_axis_2 = RotateAxis(Geometry=deconstruct_brep_4.Faces, Angle=degrees(opening_angle), Axis=list_item_4)  # -> Geometry, Transform
rotate_axis_3 = RotateAxis(Geometry=deconstruct_brep_5.Faces, Angle=degrees(opening_angle), Axis=list_item_5)  # -> Geometry, Transform

evaluate_surface_2 = EvaluateSurface(Surface=rotate_axis_3.Geometry, Point=deconstruct_brep_5.Vertices)  # -> Point, Normal, UDirection, VDirection, Frame
evaluate_surface_3 = EvaluateSurface(Surface=rotate_axis_2.Geometry, Point=deconstruct_brep_4.Vertices)  # -> Point, Normal, UDirection, VDirection, Frame
# Adding Thickness
evaluate_surface_4 = EvaluateSurface(Surface=rotate_axis.Geometry, Point=deconstruct_brep_3.Vertices)  # -> Point, Normal, UDirection, VDirection, Frame
amplitude = Amplitude(Vector=evaluate_surface_2.Normal, Amplitude=thickness)
amplitude_2 = Amplitude(Vector=evaluate_surface_4.Normal, Amplitude=thickness)
amplitude_3 = Amplitude(Vector=evaluate_surface_3.Normal, Amplitude=thickness)
extrude = Extrude(Base=rotate_axis_2.Geometry, Direction=amplitude_3)
extrude_2 = Extrude(Base=rotate_axis.Geometry, Direction=amplitude_2)
extrude_3 = Extrude(Base=rotate_axis_3.Geometry, Direction=amplitude)
