# Grasshopper definition Basic Louver.gh (Grasshopper 1.0.8)
# plug-ins: rhino-gh-mcp

# Surface Creation
number_slider = Slider(10, range=0..10)
scenario = ValueList({"Inspect (0)": 0, "Tune (1)": 1, "Coach (2)": 2, "Execute (3)": 3, "Author (4)": 4}, selected="Author (4)")
number_slider_2 = Slider(1, range=0..1)
run = BooleanToggle(False)
rectangle = Rectangle(Plane=PlaneXY(0, 0, 0), XSize=number_slider, YSize=Slider(5, range=0..10), Radius=0)  # -> Rectangle, Length
mcpv2 = RhinoGhMcpServerV2(
    RunServer=run,
    Scenario=scenario,
    Port=9999,
    OverrideAllowParameters=number_slider_2,
    OverrideAllowComponents=number_slider_2,
    OverrideAllowScripting=-1,
    OverrideComponentScope=Slider(2, range=0..10),
    AutoRecompute=False)  # -> Status, DebugOutput, Version
surface = Surface(rectangle.Rectangle)
# Surface Division
# 1U = Horizontal
# 1V = Vertical
number_slider_3 = Slider(19, range=0..31)

divide_domain² = DivideDomain²(Domain=surface, UCount=number_slider_3, VCount=Slider(1, range=0..100))
isotrim = Isotrim(FeedOGSurface=surface, Domain=divide_domain²)

md_slider = MDSlider(SliderMode=0, slider_value=Point(0.5, 0.5, 0.5), x_domain=Domain(0, 1), y_domain=Domain(0, 1), z_domain=Domain(0, 1))
evaluate_surface = EvaluateSurface(Surface=reparameterize(isotrim), Point=md_slider)  # -> Point, Normal, UDirection, VDirection, Frame
unit_y = UnitY(Factor=1)
line_sdl = LineSDL(Start=evaluate_surface.Point, Direction=unit_y, Length=Slider(1, range=0..1))

# ----
# Louver Rotation
degree_of_rotation = Slider(70, range=0..100)
radians = Radians(Degrees=degree_of_rotation)
rotate_axis = RotateAxis(Geometry=isotrim, Angle=radians, Axis=line_sdl)  # -> Geometry, Transform

# ----
# Adding Thickness
thickness = Slider(0.115, range=0..1)
amplitude = Amplitude(Vector=evaluate_surface.Normal, Amplitude=thickness)
extrude = Extrude(Base=rotate_axis.Geometry, Direction=amplitude)
