# Grasshopper definition Wavy Louver Example.gh (Grasshopper 1.0.8)
# plug-ins: rhino-gh-mcp

construct_point = ConstructPoint(XCoordinate=0, YCoordinate=0, ZCoordinate=0)
series = Series(Start=0, Step=Slider(1, range=0..10000), Count=Slider(5, range=0..10))
scenario = ValueList({"Inspect (0)": 0, "Tune (1)": 1, "Coach (2)": 2, "Execute (3)": 3, "Author (4)": 4}, selected="Author (4)")
number_slider = Slider(1, range=0..1)
unit_z = UnitZ(Factor=series)
run = BooleanToggle(False)
move = Move(Geometry=construct_point, Motion=unit_z)  # -> Geometry, Transform
unit_x = UnitX(Factor=Slider(7, range=0..100))
mcpv2 = RhinoGhMcpServerV2(
    RunServer=run,
    Scenario=scenario,
    Port=9999,
    OverrideAllowParameters=number_slider,
    OverrideAllowComponents=number_slider,
    OverrideAllowScripting=-1,
    OverrideComponentScope=Slider(2, range=0..10),
    AutoRecompute=False)  # -> Status, DebugOutput, Version
move_2 = Move(Geometry=move.Geometry, Motion=unit_x)  # -> Geometry, Transform
list_length = ListLength(List=[move.Geometry, move_2.Geometry])
random = Random(Range="0.5 to 0.75", Number=list_length, Seed=Slider(2, range=0..10))
unit_y = UnitY(Factor=random)
move_3 = Move(Geometry=[move_2.Geometry, move.Geometry], Motion=unit_y)  # -> Geometry, Transform
split_list = SplitList(List=move_3.Geometry, Index=expr("x/2", list_length))  # -> ListA, ListB
interpolate_t = InterpolateT(Vertices=split_list.ListA, TangentStart=Vector(0, 0, 0), TangentEnd=Vector(0, 0, 0), KnotStyle=1)  # -> Curve, Length, Domain
interpolate_t_2 = InterpolateT(Vertices=split_list.ListB, TangentStart=Vector(0, 0, 0), TangentEnd=Vector(0, 0, 0), KnotStyle=1)  # -> Curve, Length, Domain
# Curved Surface
loft = Loft(
    Curves=[interpolate_t.Curve, interpolate_t_2.Curve],
    Options={Adjust=False, Closed=False, LoftEnds=0, LoftSimp=0, LoftType=0, Rebuild=10, Refit=0.01})
unit_x_2 = UnitX(Factor=1)
contour = Contour(Shape=loft, Point=construct_point, Direction=unit_x_2, Distance=Slider(0.5, range=0..0.501))
xz_plane = XZPlane(Origin=construct_point)
project = Project(Geometry=contour, Plane=xz_plane)  # -> Geometry, Transform
unit_x_3 = UnitX(Factor=Slider(0.1, range=0..1))
# Wavy Blades
loft_2 = Loft(
    Curves=[project.Geometry, contour],
    Options={Adjust=False, Closed=False, LoftEnds=0, LoftSimp=0, LoftType=0, Rebuild=10, Refit=0.01})
# Thickness
extrude = Extrude(Base=loft_2, Direction=unit_x_3)
