# Grasshopper definition Panelized.gh (Grasshopper 1.0.8)
# plug-ins: LunchBox

number_slider = Slider(10, range=0..10)
rectangle = Rectangle(Plane=PlaneXY(0, 0, 0), XSize=number_slider, YSize=number_slider, Radius=0)  # -> Rectangle, Length
surface = Surface(rectangle.Rectangle)
number_slider_2 = Slider(8, range=0..100)
triangle_panels_c = TrianglePanelsC(Surface=surface, UDivisions=number_slider_2, VDivisions=number_slider_2)
unit_z = UnitZ(Factor=1)
extrude = Extrude(Base=triangle_panels_c, Direction=unit_z)
