# Grasshopper definition Perforated Attractor.gh (Grasshopper 1.0.8)
# plug-ins: rhino-gh-mcp, LunchBox

rectangle = Rectangle(Plane=PlaneXY(0, 0, 0), XSize=Slider(10, range=0..10), YSize=Slider(4, range=0..10), Radius=0)  # -> Rectangle, Length
surface = Surface(rectangle.Rectangle)

scenario = ValueList({"Inspect (0)": 0, "Tune (1)": 1, "Coach (2)": 2, "Execute (3)": 3, "Author (4)": 4}, selected="Coach (2)")
number_slider = Slider(1, range=0..1)
run = BooleanToggle(False)
mcpv2 = RhinoGhMcpServerV2(
    RunServer=run,
    Scenario=scenario,
    Port=9999,
    OverrideAllowParameters=number_slider,
    OverrideAllowComponents=number_slider,
    OverrideAllowScripting=number_slider,
    OverrideComponentScope=Slider(2, range=0..10),
    AutoRecompute=False)  # -> Status, DebugOutput, Version
triangle_panels_b = TrianglePanelsB(Surface=surface, UDivisions=Slider(40, range=0..100), VDivisions=Slider(10, range=0..10))

# ----
# Attractor & Perforated Facade
# Link Cells
# Setting Attractor Curve
area = Area(Geometry=triangle_panels_b)  # -> Area, Centroid
attractor_curve = Curve(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)
pull_point = PullPoint(Point=area.Centroid, Geometry=attractor_curve, ClosestOnly=True)  # -> ClosestPoint, Distance, Index

# ----
# Attraction of Offsetted Curves
number_slider_2 = Slider(0.2, range=0..1)
minimum = Minimum(A=pull_point.Distance, B=Slider(7, range=0..10))
construct_domain = ConstructDomain(DomainStart=Slider(0.8, range=0..1), DomainEnd=number_slider_2)
bounds = Bounds(Numbers=minimum)
cells_from_panelization = Curve(triangle_panels_b)
remap_numbers = RemapNumbers(Value=minimum, Source=bounds, Target=construct_domain)  # -> Mapped, Clipped
scale = Scale(Geometry=cells_from_panelization, Center=area.Centroid, Factor=remap_numbers.Mapped)  # -> Geometry, Transform

# ----
# Differencing the Geometries
original_curve_cells_from_panelization = Curve(triangle_panels_b)
scaled_curves = Curve(scale.Geometry)
boundary_surfaces = BoundarySurfaces(Edges=[scaled_curves, original_curve_cells_from_panelization])

# ----
# Adding Thickness
thickness = Slider(0.265, range=0..1)
unit_z = UnitZ(Factor=thickness)
extrude = Extrude(Base=boundary_surfaces, Direction=unit_z)
