# Grasshopper definition Voronoi.gh (Grasshopper 1.0.8)
# plug-ins: rhino-gh-mcp

scenario = ValueList({"Inspect (0)": 0, "Tune (1)": 1, "Coach (2)": 2, "Execute (3)": 3, "Author (4)": 4}, selected="Coach (2)")
number_slider = Slider(1, range=0..1)

# ----
# Regular Voronoi Perforated Facade
# Base Surface
number_slider_2 = Slider(10, range=0..10)
rectangle = Rectangle(Plane=PlaneXY(0, 0, 0), XSize=number_slider_2, YSize=Slider(5, range=0..10), Radius=0)  # -> Rectangle, Length
surface = Surface(rectangle.Rectangle)

# ----
# Free Edge Voronoi
number_slider_3 = Slider(10, range=0..10)
rectangle_2 = Rectangle(Plane=PlaneXY(0, 0, 0), XSize=number_slider_3, YSize=Slider(8, range=0..10), Radius=0)  # -> Rectangle, Length
surface_2 = Surface(rectangle_2.Rectangle)

run = BooleanToggle(False)
mcpv2 = RhinoGhMcpServerV2(
    RunServer=run,
    Scenario=scenario,
    Port=9999,
    OverrideAllowParameters=number_slider,
    OverrideAllowComponents=number_slider,
    OverrideAllowScripting=-1,
    OverrideComponentScope=Slider(2, range=0..10),
    AutoRecompute=False)  # -> Status, DebugOutput, Version
cell_amount = Slider(43, range=0..110)

# ----
# Edges of Surface
# for Boundary
brep_edges = BrepEdges(Brep=surface)  # -> Naked, Interior, NonManifold
join_curves = JoinCurves(Curves=brep_edges.Naked, Preserve=False)

brep_edges_2 = BrepEdges(Brep=surface_2)  # -> Naked, Interior, NonManifold
join_curves_2 = JoinCurves(Curves=brep_edges_2.Naked, Preserve=False)
populate_3d = Populate3D(Region=surface_2, Count=cell_amount, Seed=1)
cell_amount_2 = Slider(30, range=0..110)
voronoi = Voronoi(Points=populate_3d, Boundary=join_curves_2, BruteForceOverride=False)
populate_3d_2 = Populate3D(Region=surface, Count=cell_amount_2, Seed=1)
voronoi_2 = Voronoi(Points=populate_3d_2, Boundary=join_curves, BruteForceOverride=False)

# ----
# Removing Edge Cells
curve_curve = CurveCurve(CurveA=join_curves_2, CurveB=voronoi)  # -> Points, ParamsA, ParamsB
list_length = ListLength(List=curve_curve.Points)  # -> flatten(Length)
dispatch = Dispatch(List=voronoi, DispatchPattern=list_length)  # -> ListA, ListB

curve = Curve(voronoi_2)
offset_curve_loose = OffsetCurveLoose(Curve=curve, Distance=expr("-x", Slider(0.158, range=0..1)))  # -> graft(Curve)
curve_2 = Curve(dispatch.ListB)
offset_curve_loose_2 = OffsetCurveLoose(Curve=curve_2, Distance=expr("-x", Slider(0.2, range=0..1)))  # -> graft(Curve)
boundary_surfaces = BoundarySurfaces(Edges=offset_curve_loose_2)
boundary_surfaces_2 = BoundarySurfaces(Edges=offset_curve_loose)
area = Area(Geometry=boundary_surfaces_2)  # -> Area, Centroid
area_2 = Area(Geometry=boundary_surfaces)  # -> Area, Centroid
sort_list = SortList(Keys=area.Area, ValuesValuesA=boundary_surfaces_2)  # -> Keys, ValuesValuesA
sort_list_2 = SortList(Keys=area_2.Area, ValuesValuesA=boundary_surfaces)  # -> Keys, ValuesValuesA
list_item = ListItem(List=reverse(sort_list.ValuesValuesA), Index=0, Wrap=True)
list_item_2 = ListItem(List=reverse(sort_list_2.ValuesValuesA), Index=0, Wrap=True)
curve_3 = Curve(list_item)
curve_4 = Curve(list_item_2)
boundary_surfaces_3 = BoundarySurfaces(Edges=flatten([curve, curve_3]))
boundary_surfaces_4 = BoundarySurfaces(Edges=flatten([curve_2, curve_4]))

# ----
# Adding Thickness
unit_z = UnitZ(Factor=Slider(0.5, range=0..1))
extrude = Extrude(Base=boundary_surfaces_3, Direction=unit_z)

unit_z_2 = UnitZ(Factor=Slider(0.5, range=0..1))
extrude_2 = Extrude(Base=boundary_surfaces_4, Direction=unit_z_2)
